% Simulink data dictionary simulink_data_types.sldd

AirData = Simulink.Bus()
  AoA: double
  Beta: double
  Airspeed: double
  q: double

GlobalPosition = Simulink.Bus()
  LLA: double[3 1]
  V_e: double[3 1]
  GroundSpeed: double
  Course: double

States = Simulink.Bus()
  t_s: double
  p_e: double[3 1]
  v_e: double[3 1]
  v_b: double[3 1]
  a_e: double[3 1]
  a_b: double[3 1]
  q: double[1 4]
  att: double[3 1]
  omega_b: double[3 1]
  omega_e: double[3 1]
  omega_dot: double[3 1]
  R_eb: double[3 3]
  R_be: double[3 3]
  GC: boolean
  AirData: Bus: AirData
  GlobalPosition: Bus: GlobalPosition

px4_Bus_debug_array = Simulink.Bus(HeaderFile="<uORB/topics/debug_array.h>")  % px4_Bus_debug_array
  timestamp: uint64
  data: single[1 58]
  id: uint16
  name: uint8[1 10]
  _padding0: uint8[1 4]